# Grasshopper definition bone scaffold.gh (Grasshopper 1.0.7)
# plug-ins: DendroGH, Pufferfish, MeshEdit Components, IntraLattice

# ----
# bcc.bccz.afcc.vintiles.tesseract
number_slider = Slider(0, range=0..100)  # disabled
number_slider_2 = Slider(0.07, range=0..1)  # disabled
number_slider_3 = Slider(10, range=0..100)  # disabled
number_slider_4 = Slider(5, range=0..100)  # disabled
B = Base(PlaneXY(0, 0, 0))  # disabled
subtraction = Subtraction(A=number_slider_4, B=number_slider_2)  # disabled
construct_domain = ConstructDomain(DomainStart=number_slider, DomainEnd=number_slider_4)  # disabled
subtraction_2 = Subtraction(A=number_slider_3, B=number_slider_2)  # disabled
list = ValueList({"Grid": 0, "X": 1, "Star": 2, "Cross": 3, "Tesseract": 4, "Vintiles": 5, "Octet": 6, "Diamond": 7, "Honeycomb 1": 8, "Honeycomb 2": 9}, selected="Diamond")  # disabled
cyl = Cylinder(Base=B, Radius=subtraction, Length=subtraction_2)  # disabled
cap = CapHoles(Brep=cyl)  # disabled
number_slider_5 = Slider(1.7, range=0..5)  # disabled
number_slider_6 = Slider(0.5, range=0..5)  # disabled
preset_cell = PresetCell(CellTye=list)  # -> Topology, Lines; disabled
uniformds = UniformDS(
    Topology=preset_cell.Topology,
    DesignSpace=cap,
    OrientationPlane=PlaneXY(0, 0, 0),
    CellSizeX=number_slider_5,
    CellSizeY=number_slider_5,
    CellSizeZ=number_slider_5,
    Tolerance=number_slider_6,
    StrictTolerance=False)  # disabled

number_slider_7 = Slider(5, range=0..10)  # disabled
number_slider_8 = Slider(8, range=0..10)  # disabled
number_slider_9 = Slider(-1, range=-1..2)  # disabled
number_slider_10 = Slider(0, range=0..50)  # disabled
number_slider_11 = Slider(0, range=0..50)  # disabled
边界盒子_根据半径和高度输出 = Cylinder(Base=PlaneXY(0, 0, 0), Radius=expr("x", number_slider_8), Length=expr("x", number_slider_11))  # disabled
边界盒子_根据半径和高度输出_2 = Cylinder(Base=PlaneXY(0, 0, 0), Radius=expr("x", number_slider_7), Length=expr("x", number_slider_11))  # disabled
边界盒子_根据半径和高度输出_3 = Cylinder(Base=PlaneXY(0, 0, 0), Radius=expr("x+0.2", number_slider_7), Length=expr("x+0.2", number_slider_11))  # disabled
number_slider_12 = Slider(0, range=0..1)  # disabled
number_slider_13 = Slider(0, range=0..10)  # disabled
number_slider_14 = Slider(0, range=0..100)  # disabled
number_slider_15 = Slider(0, range=0..100)  # disabled
number_slider_16 = Slider(0, range=0..100)  # disabled
number_slider_17 = Slider(0, range=0..100)  # disabled
number_slider_18 = Slider(0, range=0..100)  # disabled
number_slider_19 = Slider(0, range=0..100)  # disabled
unit_z = UnitZ(Factor=number_slider_9)  # disabled
move = Move(Geometry=边界盒子_根据半径和高度输出, Motion=unit_z)  # -> Geometry, Transform; disabled
move_2 = Move(Geometry=边界盒子_根据半径和高度输出_2, Motion=unit_z)  # -> Geometry, Transform; disabled
move_3 = Move(Geometry=边界盒子_根据半径和高度输出_3, Motion=unit_z)  # -> Geometry, Transform; disabled
ghpython_script = GhPythonScript(
    radius=number_slider_10,
    height=number_slider_11,
    n1=number_slider_18,
    n2=number_slider_14,
    n3=number_slider_15,
    n4=number_slider_16,
    n5=number_slider_19,
    m=number_slider_13,
    p=number_slider_17,
    sphere_radius=number_slider_12)  # -> out, a, b, c, d; inputs n1: Int32, n2: Int32, n3: Int32, n4: Int32, n5: Int32, m: Int32, p: Int32, sphere_radius: Int32; disabled
# ---------- ghpython_script: Python ----------
import Rhino.Geometry as rg
import math
import random

points = []
spheres = []
random_points = []
m = 5
n_list = [n1, n2, n3, n4, n5]
r_list = [i * radius / (m - 1) for i in range(m)] 
sorted_r_list = sorted(r_list) 
sphere_radius = 1 
min_distance = 0.96
min_distance_in_sphere = 1 
global_min_distance = 1 

def generate_random_point_in_sphere(sphere):
    r = random.uniform(0, sphere.Radius)
    theta = random.uniform(0, math.pi)
    phi = random.uniform(0, 2 * math.pi)
    x = r * math.sin(theta) * math.cos(phi) + sphere.Center.X
    y = r * math.sin(theta) * math.sin(phi) + sphere.Center.Y
    z = r * math.cos(theta) + sphere.Center.Z
    return rg.Point3d(x, y, z)

def is_valid_point(point, points, min_distance):
    for p in points:
        if point.DistanceTo(p) < min_distance:
            return False
    return True

for i in range(m):
    n = n_list[i]
    r = r_list[i]
    r_index = sorted_r_list.index(r) + 1 
    for j in range(n):
        angle = j * 2 * math.pi / n
        for k in range(p):
            x = r * math.cos(angle)
            y = r * math.sin(angle)
            z = k * height / p
            point = rg.Point3d(x, y, z)
            points.append(point)
            sphere = rg.Sphere(point, sphere_radius)
            spheres.append(sphere)
            points_in_sphere = []
            num_points = i+1 
            for j in range(num_points):
                random_point = generate_random_point_in_sphere(sphere)
                while not is_valid_point(random_point, points_in_sphere, min_distance_in_sphere): 
                    random_point = generate_random_point_in_sphere(sphere)
                points_in_sphere.append(random_point)
            random_points.extend(points_in_sphere)

valid_random_points = []
for point in random_points:
    if is_valid_point(point, valid_random_points, global_min_distance):
        valid_random_points.append(point)
    else:
        for sphere in spheres:
            if point.DistanceTo(sphere.Center) <= sphere.Radius: 
                new_point = generate_random_point_in_sphere(sphere)
                while not is_valid_point(new_point, valid_random_points, global_min_distance):
                    new_point = generate_random_point_in_sphere(sphere)
                valid_random_points.append(new_point)

a = points
b = spheres
c = valid_random_points 
bounding_box = rg.BoundingBox(points)
d = bounding_box
# ---------- end ghpython_script ----------
brep_join = BrepJoin(Breps=move.Geometry)  # -> Breps, Closed; disabled
孔隙率采用 = CapHoles(Brep=brep_join.Breps)  # disabled
mesh_brep = MeshBrep(
    Brep=孔隙率采用,
    Settings={GridMaxCount=0, GridMinCount=16, JaggedSeams=False, MaxEdgeLength=0, MinEdgeLength=0.0001, MinTolerance=0, Refine=True, RefineAngle=0, RelativeTolerance=0.65, SimplePlanes=True, Tolerance=0})  # disabled
is_mesh_closed = IsMeshClosed(Mesh=mesh_brep)  # disabled
brep_join_2 = BrepJoin(Breps=move_2.Geometry)  # -> Breps, Closed; disabled
孔隙率采用_2 = CapHoles(Brep=brep_join_2.Breps)  # disabled
演示专用_大一些 = CapHoles(Brep=move_3.Geometry)  # disabled
mesh_brep_2 = MeshBrep(
    Brep=孔隙率采用_2,
    Settings={GridMaxCount=0, GridMinCount=16, JaggedSeams=False, MaxEdgeLength=0, MinEdgeLength=0.0001, MinTolerance=0, Refine=True, RefineAngle=0, RelativeTolerance=0.65, SimplePlanes=True, Tolerance=0})  # disabled
is_mesh_closed_2 = IsMeshClosed(Mesh=mesh_brep_2)  # disabled
panel = Panel(is_mesh_closed)  # disabled
panel_2 = Panel(is_mesh_closed_2)  # disabled
# 随机点在球体内，m1-m5 54321
point = Point(ghpython_script.c)  # disabled

flatten = FlattenTree(Tree=uniformds, Path="{0}")  # disabled

voronoi³ = Voronoi3D(Points=point, Box=mesh_brep)  # -> Cells, Boundary; disabled
edges = BrepEdges(Brep=孔隙率采用_2)  # -> Naked, Interior, NonManifold; disabled
rotate = Rotate(Geometry=孔隙率采用_2, Angle=3.141592654, Plane=PlaneXY(0, 0, 0))  # -> Geometry, Transform; disabled
sint = SolidIntersection(BrepsA=voronoi³.Cells, BrepsB=rotate.Geometry)  # disabled
sint_2 = SolidIntersection(BrepsA=voronoi³.Cells, BrepsB=孔隙率采用_2)  # disabled
cls = Closed(Curve=edges.Interior)  # -> Closed, Periodic; disabled
cull = CullPattern(List=edges.Interior, CullPattern=invert(cls.Closed))  # disabled
colom = CollisionOneMany(Collider=sint_2, Obstacles=cull)  # -> Collision, Index; disabled
cull_2 = CullPattern(List=sint_2, CullPattern=colom.Collision)  # disabled
cull_3 = CullPattern(List=sint, CullPattern=colom.Collision)  # disabled
index = ItemIndex(List=sint_2, Item=cull_2)  # disabled
replace = ReplaceItems(List=sint_2, Item=cull_3, Indices=index, Wrap=False)  # disabled
edges_2 = BrepEdges(Brep=replace)  # -> Naked, flatten(Interior), NonManifold; disabled
midpt = CurveMiddle(Curve=edges_2.Interior)  # disabled
panel_3 = Panel("0.01")  # disabled
cullpt = CullDuplicates(Points=midpt, Tolerance=panel_3, CullMode=1)  # -> Points, Indices, Valence; disabled
item = ListItem(List=edges_2.Interior, Index=cullpt.Indices, Wrap=True)  # disabled

number_slider_20 = Slider(0, range=-1..2)  # disabled
边界盒子_根据半径和高度输出_4 = Cylinder(Base=PlaneXY(0, 0, 0), Radius=5, Length=10)  # disabled
unit_z_2 = UnitZ(Factor=number_slider_20)  # disabled
move_4 = Move(Geometry=边界盒子_根据半径和高度输出_4, Motion=unit_z_2)  # -> Geometry, Transform; disabled
brep_join_3 = BrepJoin(Breps=move_4.Geometry)  # -> Breps, Closed; disabled
孔隙率采用_3 = CapHoles(Brep=brep_join_3.Breps)  # disabled
mesh_brep_3 = MeshBrep(
    Brep=孔隙率采用_3,
    Settings={GridMaxCount=0, GridMinCount=16, JaggedSeams=False, MaxEdgeLength=0, MinEdgeLength=0.0001, MinTolerance=0, Refine=True, RefineAngle=0, RelativeTolerance=0.65, SimplePlanes=True, Tolerance=0})  # disabled
is_mesh_closed_3 = IsMeshClosed(Mesh=mesh_brep_3)  # disabled
panel_4 = Panel(is_mesh_closed_3)  # disabled

number_slider_21 = Slider(4.5, range=0..10)  # disabled
number_slider_22 = Slider(10, range=0..10)  # disabled
number_slider_23 = Slider(-1, range=-1..2)  # disabled
边界盒子_根据半径和高度输出_5 = Cylinder(Base=PlaneXY(0, 0, 0), Radius=expr("x+0.7", number_slider_21), Length=expr("x+0.2", number_slider_22))  # disabled
unit_z_3 = UnitZ(Factor=number_slider_23)  # disabled
move_5 = Move(Geometry=边界盒子_根据半径和高度输出_5, Motion=unit_z_3)  # -> Geometry, Transform; disabled
演示专用_大一些_2 = CapHoles(Brep=move_5.Geometry)  # disabled

ghpython_script_2 = GhPythonScript(x=[Point(-2.199839765, -4.699049775, 0.43693704), Point(2.046344015, -6.203961518, -0.3947630595), Point(-6.052017798, -0.7882943284, -0.6664862427), Point(-4.40752934, 0.9328375634, 5.939806149), Point(-4.966535674, 4.25758591, 0.432829329), Point(1.614569021, 5.628136183, 5.552773138)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])  # -> a, b, c, d, f; inputs x: list
# ---------- ghpython_script_2: Python ----------
import rhinoscriptsyntax as rs

# 定义一个空列表，用来存储每个点到z轴的距离
distances = []

# 定义一个空列表，用来存储每个点的输出数据
outputs = []

# 循环遍历输入的点列表
for point in x:

  # 获取每个点的坐标
  coord = rs.PointCoordinates(point)

  # 计算每个点到z轴的距离，也就是x和y坐标的平方和开根号
  distance = (coord[0] ** 2 + coord[1] ** 2) ** 0.5

  # 将距离添加到列表中
  distances.append(distance)

# 计算最大和最小的距离
max_distance = max(distances)
min_distance = min(distances)

# 循环遍历距离列表
for distance in distances:

  # 根据距离等比例在0.35-0.20 70  0.22(0.30-0.25) 68输出数据，也就是使用线性插值公式
  output = 0.22 + (distance - min_distance) / (max_distance - min_distance) * (0.30 - 0.25)

  # 将输出数据添加到列表中
  outputs.append(output)

# 将列表作为输出返回
a = outputs

# 修改部分：将输出数据转换为百分比格式，也就是乘以100并保留两位小数
b = [round(output * 100, 2) for output in outputs]
c = distances
d = max_distance
f = min_distance
# ---------- end ghpython_script_2 ----------

panel_5 = Panel(point)  # disabled
number_slider_24 = Slider(0.5, range=0..1)  # disabled
# Porosity calculation
mesh_brep_4 = MeshBrep(
    Brep=演示专用_大一些_2,
    Settings={GridMaxCount=0, GridMinCount=16, JaggedSeams=False, MaxEdgeLength=0, MinEdgeLength=0.0001, MinTolerance=0, Refine=True, RefineAngle=0, RelativeTolerance=0.65, SimplePlanes=True, Tolerance=0})  # disabled

geometry = Geometry(mesh_brep_4)  # disabled

bounding_box_factor = Slider(1, range=0..1)  # disabled
# Downscaling bounding box
volume = Volume(Geometry=geometry)  # -> Volume, Centroid; disabled
scale = Scale(Geometry=geometry, Center=volume.Centroid, Factor=bounding_box_factor)  # -> Geometry, Transform; disabled

flatten_2 = FlattenTree(Tree=item, Path="{0}")  # disabled

voxel_point_res = Slider(50, range=0..1000)  # disabled
divide = DivideCurve(Curve=flatten_2, Count=voxel_point_res, Kinks=False)  # -> flatten(Points), Tangents, Parameters; disabled
pt = Point(divide.Points)  # disabled

pt_2 = Point(pt)  # disabled
ghpython_script_3 = GhPythonScript(x=pt_2)  # -> a, b, c, d, f; inputs x: list; disabled
# ---------- ghpython_script_3: Python ----------
import rhinoscriptsyntax as rs


distances = []


outputs = []


for point in x:


  coord = rs.PointCoordinates(point)


  distance = (coord[0] ** 2 + coord[1] ** 2) ** 0.5


  distances.append(distance)


max_distance = max(distances)
min_distance = min(distances)

for distance in distances:


  output = 0.15 + (distance - min_distance) / (max_distance - min_distance) * (0.35 - 0.15)


  outputs.append(output)


a = outputs


b = [round(output * 100, 2) for output in outputs]
c = distances
d = max_distance
f = min_distance
# ---------- end ghpython_script_3 ----------
panel_6 = Panel(ghpython_script_3.a)  # disabled

number_slider_25 = Slider(0.05, range=0..1)  # disabled
vsettings = CreateSettings(VoxelSize=number_slider_25, Bandwidth=1, Isovalue=0, Adaptivity=0.2)  # disabled
vpoints = PointsToVolume(Points=pt_2, PointRadius=panel_6, Settings=vsettings)  # disabled
vsmooth = SmoothVolume(Volume=vpoints, Width=1, Type=2, Iterations=3)  # disabled
mvolume = VolumeToMesh(Volume=vsmooth, VolumeSettings=vsettings)  # disabled
mesh = Mesh(mvolume)  # disabled
preview = CustomPreview(
    Geometry=mvolume,
    Material={diffuse=RGB(221, 160, 221), emission=RGB(66, 48, 66), shine=0.5, specular=RGB(255, 255, 255), transparency=0})  # disabled

is_mesh_closed_4 = IsMeshClosed(Mesh=mvolume)  # disabled
panel_7 = Panel(is_mesh_closed_4)  # disabled

area = Area(Geometry=mvolume)  # -> Area, Centroid; disabled
volume_2 = MeshVolume(Mesh=mvolume)  # -> Volume, Centroid; disabled
division = Division(A=area.Area, B=volume_2.Volume)  # disabled
panel_8 = Panel(division)  # disabled

curve = Curve(flatten)  # disabled

voxel_point_res_2 = Slider(50, range=0..1000)  # disabled

flatten_3 = FlattenTree(Tree=curve, Path="{0}")  # disabled

divide_2 = DivideCurve(Curve=flatten_3, Count=voxel_point_res_2, Kinks=False)  # -> flatten(Points), Tangents, Parameters; disabled
pt_3 = Point(divide_2.Points)  # disabled

pt_4 = Point(pt_3)  # disabled
ghpython_script_4 = GhPythonScript(x=pt_4)  # -> a, b, c, d, f; inputs x: list; disabled
# ---------- ghpython_script_4: Python ----------
import rhinoscriptsyntax as rs


distances = []


outputs = []


for point in x:


  coord = rs.PointCoordinates(point)


  distance = (coord[0] ** 2 + coord[1] ** 2) ** 0.5


  distances.append(distance)


max_distance = max(distances)
min_distance = min(distances)


for distance in distances:


  output = 0.15 + (distance - min_distance) / (max_distance - min_distance) * (0.35 - 0.15)


  outputs.append(output)


a = outputs


b = [round(output * 100, 2) for output in outputs]
c = distances
d = max_distance
f = min_distance
# ---------- end ghpython_script_4 ----------
panel_9 = Panel(ghpython_script_4.a)  # disabled

panel_10 = Panel(pt_4)  # disabled

number_slider_26 = Slider(0.05, range=0..1)  # disabled
vsettings_2 = CreateSettings(VoxelSize=number_slider_26, Bandwidth=1, Isovalue=0, Adaptivity=0.2)  # disabled
vpoints_2 = PointsToVolume(Points=pt_4, PointRadius=panel_9, Settings=vsettings_2)  # disabled
vsmooth_2 = SmoothVolume(Volume=vpoints_2, Width=1, Type=2, Iterations=3)  # disabled
mvolume_2 = VolumeToMesh(Volume=vsmooth_2, VolumeSettings=vsettings_2)  # disabled
mesh_2 = Mesh(mvolume_2)  # disabled
preview_2 = CustomPreview(
    Geometry=mvolume_2,
    Material={diffuse=RGB(221, 160, 221), emission=RGB(66, 48, 66), shine=0.5, specular=RGB(255, 255, 255), transparency=0})  # disabled

number_slider_27 = Slider(100, range=0..100)  # disabled

# ----
# Porosity calculation
volume_3 = MeshVolume(Mesh=mvolume)  # -> Volume, Centroid; disabled
volume_4 = MeshVolume(Mesh=scale.Geometry)  # -> Volume, Centroid; disabled
division_2 = Division(A=volume_3.Volume, B=volume_4.Volume)  # disabled
multiplication = Multiplication(A=division_2, B=100)  # disabled
panel_11 = Panel("ratio ")  # disabled
panel_12 = Panel("%")  # disabled

panel_13 = Panel(volume_4.Volume)  # disabled
subtraction_3 = Subtraction(A=number_slider_27, B=multiplication)  # disabled

concat = Concatenate(FragmentA=panel_11, FragmentB=subtraction_3, FragmentC=panel_12)  # disabled
panel_14 = Panel(concat)  # disabled

bounding_box_factor_2 = Slider(1.1, range=0..2)  # disabled

number_slider_28 = Slider(100, range=0..100)  # disabled
area_2 = Area(Geometry=mesh_2)  # -> Area, Centroid; disabled
geometry_2 = Geometry(mesh_brep_3)  # disabled
volume_5 = MeshVolume(Mesh=mesh_2)  # -> Volume, Centroid; disabled
division_3 = Division(A=area_2.Area, B=volume_5.Volume)  # disabled
panel_15 = Panel(division_3)  # disabled

bounding_box_factor_3 = Slider(1, range=0..1)  # disabled
volume_6 = Volume(Geometry=geometry_2)  # -> Volume, Centroid; disabled
scale_2 = Scale(Geometry=geometry_2, Center=volume_6.Centroid, Factor=bounding_box_factor_3)  # -> Geometry, Transform; disabled

mesh_intersection = MeshIntersection(MeshesA=scale_2.Geometry, MeshesB=mvolume_2)  # disabled
mesh_difference = MeshDifference(MeshesA=scale_2.Geometry, MeshesB=mvolume_2)  # disabled
number_slider_29 = Slider(100, range=0..100)  # disabled

volume_7 = Volume(Geometry=mesh_intersection)  # -> Volume, Centroid; disabled
scale_3 = Scale(Geometry=mesh_intersection, Center=volume_7.Centroid, Factor=bounding_box_factor_2)  # -> Geometry, Transform; disabled

volume_8 = MeshVolume(Mesh=mesh_brep_3)  # -> Volume, Centroid; disabled
volume_9 = MeshVolume(Mesh=mesh_2)  # -> Volume, Centroid; disabled
division_4 = Division(A=volume_9.Volume, B=volume_8.Volume)  # disabled
multiplication_2 = Multiplication(A=division_4, B=100)  # disabled
panel_16 = Panel("ratio ")  # disabled
panel_17 = Panel("%")  # disabled

subtraction_4 = Subtraction(A=number_slider_28, B=multiplication_2)  # disabled
panel_18 = Panel(multiplication_2)  # disabled

concat_2 = Concatenate(FragmentA=panel_16, FragmentB=subtraction_4, FragmentC=panel_17)  # disabled
panel_19 = Panel(concat_2)  # disabled

volume_10 = MeshVolume(Mesh=geometry_2)  # -> Volume, Centroid; disabled
panel_20 = Panel("ratio ")  # disabled
panel_21 = Panel("%")  # disabled

mesh_difference_2 = MeshDifference(MeshesA=scale_2.Geometry, MeshesB=scale_3.Geometry)  # disabled
is_mesh_closed_5 = IsMeshClosed(Mesh=mesh_difference_2)  # disabled
panel_22 = Panel(is_mesh_closed_5)  # disabled

area_3 = Area(Geometry=mesh_difference_2)  # -> Area, Centroid; disabled
volume_11 = MeshVolume(Mesh=mesh_difference_2)  # -> Volume, Centroid; disabled
division_5 = Division(A=area_3.Area, B=volume_11.Volume)  # disabled
panel_23 = Panel(division_5)  # disabled

volume_12 = MeshVolume(Mesh=mesh_difference_2)  # -> Volume, Centroid; disabled
division_6 = Division(A=volume_12.Volume, B=volume_10.Volume)  # disabled
multiplication_3 = Multiplication(A=division_6, B=100)  # disabled

subtraction_5 = Subtraction(A=number_slider_29, B=multiplication_3)  # disabled

concat_3 = Concatenate(FragmentA=panel_20, FragmentB=subtraction_5, FragmentC=panel_21)  # disabled
panel_24 = Panel(concat_3)  # disabled
